% Simulink data dictionary Heart_3D.sldd
% references N_dd.sldd
% references M_dd.sldd
% references NM_dd.sldd
% references Path_dd.sldd
% references Sensing_dd.sldd
% references Wavefront_type.sldd
% references PM_DDD_dd.sldd
% references Leads_3D.sldd
% references SharedConfigData.sldd

HeartCfgBus = Simulink.Bus()
  SA: Bus: Config_N
  SA_a: Bus: Config_M
  SA_b: Bus: Config_M
  SA_c: Bus: Config_M
  SA_d: Bus: Config_NM
  CT: Bus: Config_M
  CT_a: Bus: Config_NM
  OS: Bus: Config_NM
  RE: Bus: Config_N
  LNB: Bus: Config_NM
  TC_f: Bus: Config_NM
  CN: Bus: Config_N
  RA_a: Bus: Config_M
  RA: Bus: Config_M
  CS_LA: Bus: Config_NM
  Bach: Bus: Config_M
  LA_a: Bus: Config_M
  LA: Bus: Config_M
  BH: Bus: Config_NM
  His_p: Bus: Config_NM
  His_m: Bus: Config_NM
  His_d: Bus: Config_NM
  RBB_m: Bus: Config_NM
  RBB: Bus: Config_NM
  RBB_a: Bus: Config_NM
  LBB_m: Bus: Config_NM
  LBB: Bus: Config_NM
  LBB_a: Bus: Config_NM
  RVA: Bus: Config_M
  LVA: Bus: Config_M
  SEP_RV_m: Bus: Config_M
  SEP_RV: Bus: Config_M
  RV_m: Bus: Config_NM
  RV: Bus: Config_NM
  SEP_LV: Bus: Config_M
  CS_LV: Bus: Config_M
  SEP_LV_m: Bus: Config_M
  LV_m: Bus: Config_NM
  LV: Bus: Config_NM
  RV_mm: Bus: Config_M
  RVm: Bus: Config_M
  LV_mm: Bus: Config_M
  LVm: Bus: Config_M
  path_1: Bus: Config_Path
  path_2: Bus: Config_Path
  path_3: Bus: Config_Path
  path_4: Bus: Config_Path
  path_5: Bus: Config_Path
  path_6: Bus: Config_Path
  path_7: Bus: Config_Path
  path_8: Bus: Config_Path
  path_9: Bus: Config_Path
  path_10: Bus: Config_Path
  path_11: Bus: Config_Path
  path_12: Bus: Config_Path
  path_13: Bus: Config_Path
  path_14: Bus: Config_Path
  path_15: Bus: Config_Path
  path_16: Bus: Config_Path
  path_17: Bus: Config_Path
  path_18: Bus: Config_Path
  path_19: Bus: Config_Path
  path_20: Bus: Config_Path
  path_21: Bus: Config_Path
  path_22: Bus: Config_Path
  path_23: Bus: Config_Path
  path_24: Bus: Config_Path
  path_25: Bus: Config_Path
  path_26: Bus: Config_Path
  path_27: Bus: Config_Path
  path_28: Bus: Config_Path
  path_29: Bus: Config_Path
  path_30: Bus: Config_Path
  path_31: Bus: Config_Path
  path_32: Bus: Config_Path
  path_33: Bus: Config_Path
  path_34: Bus: Config_Path
  path_35: Bus: Config_Path
  path_36: Bus: Config_Path
  path_37: Bus: Config_Path
  path_38: Bus: Config_Path
  path_39: Bus: Config_Path
  path_40: Bus: Config_Path
  path_41: Bus: Config_Path
  path_42: Bus: Config_Path
  path_43: Bus: Config_Path
  path_44: Bus: Config_Path
  path_45: Bus: Config_Path
  path_46: Bus: Config_Path
  path_47: Bus: Config_Path
  path_48: Bus: Config_Path
  path_49: Bus: Config_Path
  path_50: Bus: Config_Path
  path_51: Bus: Config_Path
  path_52: Bus: Config_Path
  path_53: Bus: Config_Path
  path_54: Bus: Config_Path

HeartCfg = struct(
  SA=struct(
    BCL=0.814,
    SD=0.002,
    f1=0.1,
    f2=0.25,
    sigma1sq=0.0035,
    sigma2sq=0.007,
    d2=1281,
    ERP=0.1615,
    d0=-773.2,
    MDP=-85.3,
    VT=23.81,
    VR=47.94,
    Vh=-4,
    hr=0.1,
    hs=35,
    s=5,
    j=0,
    m=1,
    h=0.2,
    f=0.1,
    r=0.5),
  SA_a=struct(
    ax0=-103.7652,
    ay0=-31.4719,
    az0=-19.86729,
    ax1=-23.6,
    ay1=-45.5,
    az1=-12.9,
    ax2=-6.9,
    ay2=75.9,
    az2=6826.5,
    ax3=-271.1289,
    ay3=13.1311,
    az3=0.2024544,
    bx1=777.2,
    by1=58.9,
    bz1=276.6,
    VR=40.57625,
    VT=44.5,
    VO=112.4476,
    a=0.29,
    b=62.89,
    c=0.7,
    d=10.99,
    e=0.04),
  SA_b=struct(
    ax0=-103.7652,
    ay0=-31.4719,
    az0=-19.86729,
    ax1=-23.6,
    ay1=-45.5,
    az1=-12.9,
    ax2=-6.9,
    ay2=75.9,
    az2=6826.5,
    ax3=-271.1289,
    ay3=13.1311,
    az3=0.2024544,
    bx1=777.2,
    by1=58.9,
    bz1=276.6,
    VR=40.57625,
    VT=44.5,
    VO=112.4476,
    a=0.29,
    b=62.89,
    c=0.7,
    d=10.99,
    e=0.04),
  SA_c=struct(
    ax0=-103.7652,
    ay0=-31.4719,
    az0=-19.86729,
    ax1=-23.6,
    ay1=-45.5,
    az1=-12.9,
    ax2=-6.9,
    ay2=75.9,
    az2=6826.5,
    ax3=-271.1289,
    ay3=13.1311,
    az3=0.2024544,
    bx1=777.2,
    by1=58.9,
    bz1=276.6,
    VR=40.57625,
    VT=44.5,
    VO=112.4476,
    a=0.29,
    b=62.89,
    c=0.7,
    d=10.99,
    e=0.04),
  SA_d=struct(
    cfg_N=struct(
      BCL=2.1,
      SD=0.002,
      f1=0.1,
      f2=0.25,
      sigma1sq=0.0035,
      sigma2sq=0.007,
      d2=3340,
      ERP=0.108,
      d0=-944.8,
      MDP=-74.65,
      VT=25.05,
      VR=41.25,
      Vh=-15,
      hr=0.1,
      hs=35,
      s=5,
      j=2,
      m=1,
      h=0,
      f=0,
      r=0.5),
    cfg_M=struct(
      ax0=-103.7652,
      ay0=-31.4719,
      az0=-19.86729,
      ax1=-23.6,
      ay1=-45.5,
      az1=-12.9,
      ax2=-6.9,
      ay2=75.9,
      az2=6826.5,
      ax3=-271.1289,
      ay3=13.1311,
      az3=0.2024544,
      bx1=777.2,
      by1=58.9,
      bz1=276.6,
      VR=40.57625,
      VT=44.5,
      VO=112.4476,
      a=0.29,
      b=62.89,
      c=0.7,
      d=10.99,
      e=0.04)),
  CT=struct(
    ax0=-103.7652,
    ay0=-31.4719,
    az0=-19.86729,
    ax1=-23.6,
    ay1=-45.5,
    az1=-12.9,
    ax2=-6.9,
    ay2=75.9,
    az2=6826.5,
    ax3=-271.1289,
    ay3=13.1311,
    az3=0.2024544,
    bx1=777.2,
    by1=58.9,
    bz1=276.6,
    VR=40.57625,
    VT=44.5,
    VO=112.4476,
    a=0.29,
    b=62.89,
    c=0.7,
    d=10.99,
    e=0.04),
  CT_a=struct(
    cfg_N=struct(
      BCL=2.1,
      SD=0.002,
      f1=0.1,
      f2=0.25,
      sigma1sq=0.0035,
      sigma2sq=0.007,
      d2=3340,
      ERP=0.108,
      d0=-944.8,
      MDP=-74.65,
      VT=25.05,
      VR=41.25,
      Vh=-15,
      hr=0.1,
      hs=35,
      s=5,
      j=2,
      m=1,
      h=0,
      f=0,
      r=0.5),
    cfg_M=struct(
      ax0=-103.7652,
      ay0=-31.4719,
      az0=-19.86729,
      ax1=-23.6,
      ay1=-45.5,
      az1=-12.9,
      ax2=-6.9,
      ay2=75.9,
      az2=6826.5,
      ax3=-271.1289,
      ay3=13.1311,
      az3=0.2024544,
      bx1=777.2,
      by1=58.9,
      bz1=276.6,
      VR=40.57625,
      VT=44.5,
      VO=112.4476,
      a=0.29,
      b=62.89,
      c=0.7,
      d=10.99,
      e=0.04)),
  OS=struct(
    cfg_N=struct(
      BCL=2.1,
      SD=0.002,
      f1=0.1,
      f2=0.25,
      sigma1sq=0.0035,
      sigma2sq=0.007,
      d2=3340,
      ERP=0.108,
      d0=-944.8,
      MDP=-74.65,
      VT=25.05,
      VR=41.25,
      Vh=-15,
      hr=0.1,
      hs=35,
      s=5,
      j=2,
      m=1,
      h=0,
      f=0,
      r=0.5),
    cfg_M=struct(
      ax0=-103.7652,
      ay0=-31.4719,
      az0=-19.86729,
      ax1=-23.6,
      ay1=-45.5,
      az1=-12.9,
      ax2=-6.9,
      ay2=75.9,
      az2=6826.5,
      ax3=-271.1289,
      ay3=13.1311,
      az3=0.2024544,
      bx1=777.2,
      by1=58.9,
      bz1=276.6,
      VR=40.57625,
      VT=44.5,
      VO=112.4476,
      a=0.29,
      b=62.89,
      c=0.7,
      d=10.99,
      e=0.04)),
  RE=struct(
    BCL=2.1,
    SD=0.002,
    f1=0.1,
    f2=0.25,
    sigma1sq=0.0035,
    sigma2sq=0.007,
    d2=3340,
    ERP=0.278,
    d0=-944.8,
    MDP=-74.65,
    VT=25.05,
    VR=41.25,
    Vh=-4,
    hr=0.1,
    hs=35,
    s=5,
    j=0,
    m=1,
    h=0.2,
    f=0.1,
    r=0.5),
  LNB=struct(
    cfg_N=struct(
      BCL=2.3,
      SD=0.002,
      f1=0.1,
      f2=0.25,
      sigma1sq=0.0035,
      sigma2sq=0.007,
      d2=3340,
      ERP=0.108,
      d0=-944.8,
      MDP=-74.65,
      VT=25.05,
      VR=41.25,
      Vh=-15,
      hr=0.1,
      hs=35,
      s=5,
      j=2,
      m=1,
      h=0,
      f=0,
      r=0.5),
    cfg_M=struct(
      ax0=-8.7,
      ay0=-190.9,
      az0=-190.4,
      ax1=-23.6,
      ay1=-45.5,
      az1=-12.9,
      ax2=-6.9,
      ay2=75.9,
      az2=6826.5,
      ax3=-33.2,
      ay3=14.62,
      az3=2,
      bx1=777.2,
      by1=58.9,
      bz1=276.6,
      VR=30,
      VT=44.5,
      VO=131.1,
      a=0.29,
      b=62.89,
      c=0.7,
      d=10.99,
      e=0.04)),
  TC_f=struct(
    cfg_N=struct(
      BCL=2.1,
      SD=0.002,
      f1=0.1,
      f2=0.25,
      sigma1sq=0.0035,
      sigma2sq=0.007,
      d2=3340,
      ERP=0.108,
      d0=-944.8,
      MDP=-74.65,
      VT=25.05,
      VR=41.25,
      Vh=-15,
      hr=0.1,
      hs=35,
      s=5,
      j=2,
      m=1,
      h=0,
      f=0,
      r=0.5),
    cfg_M=struct(
      ax0=-103.7652,
      ay0=-31.4719,
      az0=-19.86729,
      ax1=-23.6,
      ay1=-45.5,
      az1=-12.9,
      ax2=-6.9,
      ay2=75.9,
      az2=6826.5,
      ax3=-271.1289,
      ay3=8.72,
      az3=0.2024544,
      bx1=777.2,
      by1=58.9,
      bz1=276.6,
      VR=40.57625,
      VT=44.5,
      VO=112.4476,
      a=0.29,
      b=62.89,
      c=0.7,
      d=10.99,
      e=0.04)),
  CN=struct(
    BCL=1.5,
    SD=0.002,
    f1=0.1,
    f2=0.25,
    sigma1sq=0.0035,
    sigma2sq=0.007,
    d2=3340,
    ERP=0.214,
    d0=-944.8,
    MDP=-74.65,
    VT=25.05,
    VR=41.25,
    Vh=-4,
    hr=0.1,
    hs=35,
    s=5,
    j=0,
    m=1,
    h=0.2,
    f=0.8,
    r=0.5),
  RA_a=struct(
    ax0=-103.7652,
    ay0=-31.4719,
    az0=-19.86729,
    ax1=-23.6,
    ay1=-45.5,
    az1=-12.9,
    ax2=-6.9,
    ay2=75.9,
    az2=6826.5,
    ax3=-271.1289,
    ay3=13.1311,
    az3=0.2024544,
    bx1=777.2,
    by1=58.9,
    bz1=276.6,
    VR=40.57625,
    VT=44.5,
    VO=112.4476,
    a=0.29,
    b=62.89,
    c=0.7,
    d=10.99,
    e=0.04),
  RA=struct(
    ax0=-103.7652,
    ay0=-31.4719,
    az0=-19.86729,
    ax1=-23.6,
    ay1=-45.5,
    az1=-12.9,
    ax2=-6.9,
    ay2=75.9,
    az2=6826.5,
    ax3=-271.1289,
    ay3=13.1311,
    az3=0.2024544,
    bx1=777.2,
    by1=58.9,
    bz1=276.6,
    VR=40.57625,
    VT=44.5,
    VO=112.4476,
    a=0.29,
    b=62.89,
    c=0.7,
    d=10.99,
    e=0.04),
  CS_LA=struct(
    cfg_N=struct(
      BCL=2.2,
      SD=0.002,
      f1=0.1,
      f2=0.25,
      sigma1sq=0.0035,
      sigma2sq=0.007,
      d2=3340,
      ERP=0.108,
      d0=-944.8,
      MDP=-74.65,
      VT=25.05,
      VR=41.25,
      Vh=-15,
      hr=0.1,
      hs=35,
      s=5,
      j=2,
      m=1,
      h=0,
      f=0,
      r=0.5),
    cfg_M=struct(
      ax0=-103.7652,
      ay0=-31.4719,
      az0=-19.86729,
      ax1=-23.6,
      ay1=-45.5,
      az1=-12.9,
      ax2=-6.9,
      ay2=75.9,
      az2=6826.5,
      ax3=-271.1289,
      ay3=13.1311,
      az3=0.2024544,
      bx1=777.2,
      by1=58.9,
      bz1=276.6,
      VR=40.57625,
      VT=44.5,
      VO=112.4476,
      a=0.29,
      b=62.89,
      c=0.7,
      d=10.99,
      e=0.04)),
  Bach=struct(
    ax0=-103.7652,
    ay0=-31.4719,
    az0=-19.86729,
    ax1=-23.6,
    ay1=-45.5,
    az1=-12.9,
    ax2=-6.9,
    ay2=75.9,
    az2=6826.5,
    ax3=-271.1289,
    ay3=13.1311,
    az3=0.2024544,
    bx1=777.2,
    by1=58.9,
    bz1=276.6,
    VR=40.57625,
    VT=44.5,
    VO=112.4476,
    a=0.29,
    b=62.89,
    c=0.7,
    d=10.99,
    e=0.04),
  LA_a=struct(
    ax0=-103.7652,
    ay0=-31.4719,
    az0=-19.86729,
    ax1=-23.6,
    ay1=-45.5,
    az1=-12.9,
    ax2=-6.9,
    ay2=75.9,
    az2=6826.5,
    ax3=-271.1289,
    ay3=13.1311,
    az3=0.2024544,
    bx1=777.2,
    by1=58.9,
    bz1=276.6,
    VR=40.57625,
    VT=44.5,
    VO=112.4476,
    a=0.29,
    b=62.89,
    c=0.7,
    d=10.99,
    e=0.04),
  LA=struct(
    ax0=-103.7652,
    ay0=-31.4719,
    az0=-19.86729,
    ax1=-23.6,
    ay1=-45.5,
    az1=-12.9,
    ax2=-6.9,
    ay2=75.9,
    az2=6826.5,
    ax3=-271.1289,
    ay3=13.1311,
    az3=0.2024544,
    bx1=777.2,
    by1=58.9,
    bz1=276.6,
    VR=40.57625,
    VT=44.5,
    VO=112.4476,
    a=0.29,
    b=62.89,
    c=0.7,
    d=10.99,
    e=0.04),
  BH=struct(
    cfg_N=struct(
      BCL=2.3,
      SD=0.002,
      f1=0.1,
      f2=0.25,
      sigma1sq=0.0035,
      sigma2sq=0.007,
      d2=3340,
      ERP=0.108,
      d0=-944.8,
      MDP=-74.65,
      VT=25.05,
      VR=41.25,
      Vh=-15,
      hr=0.1,
      hs=35,
      s=5,
      j=2,
      m=1,
      h=0,
      f=0,
      r=0.5),
    cfg_M=struct(
      ax0=-8.7,
      ay0=-190.9,
      az0=-190.4,
      ax1=-23.6,
      ay1=-45.5,
      az1=-12.9,
      ax2=-6.9,
      ay2=75.9,
      az2=6826.5,
      ax3=-33.2,
      ay3=13.94,
      az3=2,
      bx1=777.2,
      by1=58.9,
      bz1=276.6,
      VR=30,
      VT=44.5,
      VO=131.1,
      a=0.29,
      b=62.89,
      c=0.7,
      d=10.99,
      e=0.04)),
  His_p=struct(
    cfg_N=struct(
      BCL=2.3,
      SD=0.002,
      f1=0.1,
      f2=0.25,
      sigma1sq=0.0035,
      sigma2sq=0.007,
      d2=3340,
      ERP=0.108,
      d0=-944.8,
      MDP=-74.65,
      VT=25.05,
      VR=41.25,
      Vh=-15,
      hr=0.1,
      hs=35,
      s=5,
      j=2,
      m=1,
      h=0,
      f=0,
      r=0.5),
    cfg_M=struct(
      ax0=-8.7,
      ay0=-190.9,
      az0=-190.4,
      ax1=-23.6,
      ay1=-45.5,
      az1=-12.9,
      ax2=-6.9,
      ay2=75.9,
      az2=6826.5,
      ax3=-33.2,
      ay3=11.06,
      az3=2,
      bx1=777.2,
      by1=58.9,
      bz1=276.6,
      VR=30,
      VT=44.5,
      VO=131.1,
      a=0.29,
      b=62.89,
      c=0.7,
      d=10.99,
      e=0.04)),
  His_m=struct(
    cfg_N=struct(
      BCL=2.3,
      SD=0.002,
      f1=0.1,
      f2=0.25,
      sigma1sq=0.0035,
      sigma2sq=0.007,
      d2=3340,
      ERP=0.108,
      d0=-944.8,
      MDP=-74.65,
      VT=25.05,
      VR=41.25,
      Vh=-15,
      hr=0.1,
      hs=35,
      s=5,
      j=2,
      m=1,
      h=0,
      f=0,
      r=0.5),
    cfg_M=struct(
      ax0=-8.7,
      ay0=-190.9,
      az0=-190.4,
      ax1=-23.6,
      ay1=-45.5,
      az1=-12.9,
      ax2=-6.9,
      ay2=75.9,
      az2=6826.5,
      ax3=-33.2,
      ay3=11.14,
      az3=2,
      bx1=777.2,
      by1=58.9,
      bz1=276.6,
      VR=30,
      VT=44.5,
      VO=131.1,
      a=0.29,
      b=62.89,
      c=0.7,
      d=10.99,
      e=0.04)),
  His_d=struct(
    cfg_N=struct(
      BCL=2.3,
      SD=0.002,
      f1=0.1,
      f2=0.25,
      sigma1sq=0.0035,
      sigma2sq=0.007,
      d2=3340,
      ERP=0.108,
      d0=-944.8,
      MDP=-74.65,
      VT=25.05,
      VR=41.25,
      Vh=-15,
      hr=0.1,
      hs=35,
      s=5,
      j=2,
      m=1,
      h=0,
      f=0,
      r=0.5),
    cfg_M=struct(
      ax0=-8.7,
      ay0=-190.9,
      az0=-190.4,
      ax1=-23.6,
      ay1=-45.5,
      az1=-12.9,
      ax2=-6.9,
      ay2=75.9,
      az2=6826.5,
      ax3=-33.2,
      ay3=11.36,
      az3=2,
      bx1=777.2,
      by1=58.9,
      bz1=276.6,
      VR=30,
      VT=44.5,
      VO=131.1,
      a=0.29,
      b=62.89,
      c=0.7,
      d=10.99,
      e=0.04)),
  RBB_m=struct(
    cfg_N=struct(
      BCL=2.3,
      SD=0.002,
      f1=0.1,
      f2=0.25,
      sigma1sq=0.0035,
      sigma2sq=0.007,
      d2=3340,
      ERP=0.108,
      d0=-944.8,
      MDP=-74.65,
      VT=25.05,
      VR=41.25,
      Vh=-25,
      hr=0.1,
      hs=35,
      s=4,
      j=2,
      m=1,
      h=0,
      f=0,
      r=0.5),
    cfg_M=struct(
      ax0=-8.7,
      ay0=-190.9,
      az0=-190.4,
      ax1=-23.6,
      ay1=-45.5,
      az1=-12.9,
      ax2=-6.9,
      ay2=75.9,
      az2=6826.5,
      ax3=-33.2,
      ay3=11.66,
      az3=2,
      bx1=777.2,
      by1=58.9,
      bz1=276.6,
      VR=30,
      VT=44.5,
      VO=131.1,
      a=0.29,
      b=62.89,
      c=0.7,
      d=10.99,
      e=0.04)),
  RBB=struct(
    cfg_N=struct(
      BCL=2.3,
      SD=0.002,
      f1=0.1,
      f2=0.25,
      sigma1sq=0.0035,
      sigma2sq=0.007,
      d2=3340,
      ERP=0.108,
      d0=-944.8,
      MDP=-74.65,
      VT=25.05,
      VR=41.25,
      Vh=-25,
      hr=0.1,
      hs=35,
      s=4,
      j=2,
      m=1,
      h=0,
      f=0,
      r=0.5),
    cfg_M=struct(
      ax0=-8.7,
      ay0=-190.9,
      az0=-190.4,
      ax1=-23.6,
      ay1=-45.5,
      az1=-12.9,
      ax2=-6.9,
      ay2=75.9,
      az2=6826.5,
      ax3=-33.2,
      ay3=12.6,
      az3=2,
      bx1=777.2,
      by1=58.9,
      bz1=276.6,
      VR=30,
      VT=44.5,
      VO=131.1,
      a=0.29,
      b=62.89,
      c=0.7,
      d=10.99,
      e=0.04)),
  RBB_a=struct(
    cfg_N=struct(
      BCL=2.3,
      SD=0.002,
      f1=0.1,
      f2=0.25,
      sigma1sq=0.0035,
      sigma2sq=0.007,
      d2=3340,
      ERP=0.108,
      d0=-944.8,
      MDP=-74.65,
      VT=25.05,
      VR=41.25,
      Vh=-25,
      hr=0.1,
      hs=35,
      s=4,
      j=2,
      m=1,
      h=0,
      f=0,
      r=0.5),
    cfg_M=struct(
      ax0=-8.7,
      ay0=-190.9,
      az0=-190.4,
      ax1=-23.6,
      ay1=-45.5,
      az1=-12.9,
      ax2=-6.9,
      ay2=75.9,
      az2=6826.5,
      ax3=-33.2,
      ay3=12.98,
      az3=2,
      bx1=777.2,
      by1=58.9,
      bz1=276.6,
      VR=30,
      VT=44.5,
      VO=131.1,
      a=0.29,
      b=62.89,
      c=0.7,
      d=10.99,
      e=0.04)),
  LBB_m=struct(
    cfg_N=struct(
      BCL=2.3,
      SD=0.002,
      f1=0.1,
      f2=0.25,
      sigma1sq=0.0035,
      sigma2sq=0.007,
      d2=3340,
      ERP=0.108,
      d0=-944.8,
      MDP=-74.65,
      VT=25.05,
      VR=41.25,
      Vh=-25,
      hr=0.1,
      hs=35,
      s=4,
      j=2,
      m=1,
      h=0,
      f=0,
      r=0.5),
    cfg_M=struct(
      ax0=-8.7,
      ay0=-190.9,
      az0=-190.4,
      ax1=-23.6,
      ay1=-45.5,
      az1=-12.9,
      ax2=-6.9,
      ay2=75.9,
      az2=6826.5,
      ax3=-33.2,
      ay3=11.92,
      az3=2,
      bx1=777.2,
      by1=58.9,
      bz1=276.6,
      VR=30,
      VT=44.5,
      VO=131.1,
      a=0.29,
      b=62.89,
      c=0.7,
      d=10.99,
      e=0.04)),
  LBB=struct(
    cfg_N=struct(
      BCL=2.3,
      SD=0.002,
      f1=0.1,
      f2=0.25,
      sigma1sq=0.0035,
      sigma2sq=0.007,
      d2=3340,
      ERP=0.108,
      d0=-944.8,
      MDP=-74.65,
      VT=25.05,
      VR=41.25,
      Vh=-25,
      hr=0.1,
      hs=35,
      s=4,
      j=2,
      m=1,
      h=0,
      f=0,
      r=0.5),
    cfg_M=struct(
      ax0=-8.7,
      ay0=-190.9,
      az0=-190.4,
      ax1=-23.6,
      ay1=-45.5,
      az1=-12.9,
      ax2=-6.9,
      ay2=75.9,
      az2=6826.5,
      ax3=-33.2,
      ay3=12.92,
      az3=2,
      bx1=777.2,
      by1=58.9,
      bz1=276.6,
      VR=30,
      VT=44.5,
      VO=131.1,
      a=0.29,
      b=62.89,
      c=0.7,
      d=10.99,
      e=0.04)),
  LBB_a=struct(
    cfg_N=struct(
      BCL=2.3,
      SD=0.002,
      f1=0.1,
      f2=0.25,
      sigma1sq=0.0035,
      sigma2sq=0.007,
      d2=3340,
      ERP=0.108,
      d0=-944.8,
      MDP=-74.65,
      VT=25.05,
      VR=41.25,
      Vh=-25,
      hr=0.1,
      hs=35,
      s=4,
      j=2,
      m=1,
      h=0,
      f=0,
      r=0.5),
    cfg_M=struct(
      ax0=-8.7,
      ay0=-190.9,
      az0=-190.4,
      ax1=-23.6,
      ay1=-45.5,
      az1=-12.9,
      ax2=-6.9,
      ay2=75.9,
      az2=6826.5,
      ax3=-33.2,
      ay3=13.34,
      az3=2,
      bx1=777.2,
      by1=58.9,
      bz1=276.6,
      VR=30,
      VT=44.5,
      VO=131.1,
      a=0.29,
      b=62.89,
      c=0.7,
      d=10.99,
      e=0.04)),
  RVA=struct(
    ax0=-8.7,
    ay0=-190.9,
    az0=-190.4,
    ax1=-23.6,
    ay1=-45.5,
    az1=-12.9,
    ax2=-6.9,
    ay2=75.9,
    az2=6826.5,
    ax3=-17.80971,
    ay3=13.97137,
    az3=1.783211,
    bx1=777.2,
    by1=58.9,
    bz1=276.6,
    VR=30,
    VT=44.5,
    VO=122.8702,
    a=0.29,
    b=62.89,
    c=0.7,
    d=10.99,
    e=0.04),
  LVA=struct(
    ax0=-8.7,
    ay0=-190.9,
    az0=-190.4,
    ax1=-23.6,
    ay1=-45.5,
    az1=-12.9,
    ax2=-6.9,
    ay2=75.9,
    az2=6826.5,
    ax3=-17.80971,
    ay3=13.97137,
    az3=1.783211,
    bx1=777.2,
    by1=58.9,
    bz1=276.6,
    VR=30,
    VT=44.5,
    VO=122.8702,
    a=0.29,
    b=62.89,
    c=0.7,
    d=10.99,
    e=0.04),
  SEP_RV_m=struct(
    ax0=-8.7,
    ay0=-190.9,
    az0=-190.4,
    ax1=-23.6,
    ay1=-45.5,
    az1=-12.9,
    ax2=-6.9,
    ay2=75.9,
    az2=6826.5,
    ax3=-17.80971,
    ay3=13.97137,
    az3=1.783211,
    bx1=777.2,
    by1=58.9,
    bz1=276.6,
    VR=30,
    VT=44.5,
    VO=122.8702,
    a=0.29,
    b=62.89,
    c=0.7,
    d=10.99,
    e=0.04),
  SEP_RV=struct(
    ax0=-8.7,
    ay0=-190.9,
    az0=-190.4,
    ax1=-23.6,
    ay1=-45.5,
    az1=-12.9,
    ax2=-6.9,
    ay2=75.9,
    az2=6826.5,
    ax3=-17.80971,
    ay3=13.97137,
    az3=1.783211,
    bx1=777.2,
    by1=58.9,
    bz1=276.6,
    VR=30,
    VT=44.5,
    VO=122.8702,
    a=0.29,
    b=62.89,
    c=0.7,
    d=10.99,
    e=0.04),
  RV_m=struct(
    cfg_N=struct(
      BCL=2.3,
      SD=0.002,
      f1=0.1,
      f2=0.25,
      sigma1sq=0.0035,
      sigma2sq=0.007,
      d2=3340,
      ERP=0.108,
      d0=-944.8,
      MDP=-74.65,
      VT=25.05,
      VR=41.25,
      Vh=-25,
      hr=0.1,
      hs=35,
      s=4,
      j=2,
      m=1,
      h=0,
      f=0,
      r=0.5),
    cfg_M=struct(
      ax0=-8.7,
      ay0=-190.9,
      az0=-190.4,
      ax1=-23.6,
      ay1=-45.5,
      az1=-12.9,
      ax2=-6.9,
      ay2=75.9,
      az2=6826.5,
      ax3=-33.2,
      ay3=13.94,
      az3=2,
      bx1=777.2,
      by1=58.9,
      bz1=276.6,
      VR=30,
      VT=44.5,
      VO=131.1,
      a=0.29,
      b=62.89,
      c=0.7,
      d=10.99,
      e=0.04)),
  RV=struct(
    cfg_N=struct(
      BCL=2.3,
      SD=0.002,
      f1=0.1,
      f2=0.25,
      sigma1sq=0.0035,
      sigma2sq=0.007,
      d2=3340,
      ERP=0.108,
      d0=-944.8,
      MDP=-74.65,
      VT=25.05,
      VR=41.25,
      Vh=-25,
      hr=0.1,
      hs=35,
      s=4,
      j=2,
      m=1,
      h=0,
      f=0,
      r=0.5),
    cfg_M=struct(
      ax0=-8.7,
      ay0=-190.9,
      az0=-190.4,
      ax1=-23.6,
      ay1=-45.5,
      az1=-12.9,
      ax2=-6.9,
      ay2=75.9,
      az2=6826.5,
      ax3=-33.2,
      ay3=13.94,
      az3=2,
      bx1=777.2,
      by1=58.9,
      bz1=276.6,
      VR=30,
      VT=44.5,
      VO=131.1,
      a=0.29,
      b=62.89,
      c=0.7,
      d=10.99,
      e=0.04)),
  SEP_LV=struct(
    ax0=-8.7,
    ay0=-190.9,
    az0=-190.4,
    ax1=-23.6,
    ay1=-45.5,
    az1=-12.9,
    ax2=-6.9,
    ay2=75.9,
    az2=6826.5,
    ax3=-17.80971,
    ay3=13.97137,
    az3=1.783211,
    bx1=777.2,
    by1=58.9,
    bz1=276.6,
    VR=30,
    VT=44.5,
    VO=122.8702,
    a=0.29,
    b=62.89,
    c=0.7,
    d=10.99,
    e=0.04),
  CS_LV=struct(
    ax0=-8.7,
    ay0=-190.9,
    az0=-190.4,
    ax1=-23.6,
    ay1=-45.5,
    az1=-12.9,
    ax2=-6.9,
    ay2=75.9,
    az2=6826.5,
    ax3=-17.80971,
    ay3=13.97137,
    az3=1.783211,
    bx1=777.2,
    by1=58.9,
    bz1=276.6,
    VR=30,
    VT=44.5,
    VO=122.8702,
    a=0.29,
    b=62.89,
    c=0.7,
    d=10.99,
    e=0.04),
  SEP_LV_m=struct(
    ax0=-8.7,
    ay0=-190.9,
    az0=-190.4,
    ax1=-23.6,
    ay1=-45.5,
    az1=-12.9,
    ax2=-6.9,
    ay2=75.9,
    az2=6826.5,
    ax3=-17.80971,
    ay3=13.97137,
    az3=1.783211,
    bx1=777.2,
    by1=58.9,
    bz1=276.6,
    VR=30,
    VT=44.5,
    VO=122.8702,
    a=0.29,
    b=62.89,
    c=0.7,
    d=10.99,
    e=0.04),
  LV_m=struct(
    cfg_N=struct(
      BCL=2.3,
      SD=0.002,
      f1=0.1,
      f2=0.25,
      sigma1sq=0.0035,
      sigma2sq=0.007,
      d2=3340,
      ERP=0.108,
      d0=-944.8,
      MDP=-74.65,
      VT=25.05,
      VR=41.25,
      Vh=-25,
      hr=0.1,
      hs=35,
      s=4,
      j=2,
      m=1,
      h=0,
      f=0,
      r=0.5),
    cfg_M=struct(
      ax0=-8.7,
      ay0=-190.9,
      az0=-190.4,
      ax1=-23.6,
      ay1=-45.5,
      az1=-12.9,
      ax2=-6.9,
      ay2=75.9,
      az2=6826.5,
      ax3=-33.2,
      ay3=14.36,
      az3=2,
      bx1=777.2,
      by1=58.9,
      bz1=276.6,
      VR=30,
      VT=44.5,
      VO=131.1,
      a=0.29,
      b=62.89,
      c=0.7,
      d=10.99,
      e=0.04)),
  LV=struct(
    cfg_N=struct(
      BCL=2.3,
      SD=0.002,
      f1=0.1,
      f2=0.25,
      sigma1sq=0.0035,
      sigma2sq=0.007,
      d2=3340,
      ERP=0.108,
      d0=-944.8,
      MDP=-74.65,
      VT=25.05,
      VR=41.25,
      Vh=-25,
      hr=0.1,
      hs=35,
      s=4,
      j=2,
      m=1,
      h=0,
      f=0,
      r=0.5),
    cfg_M=struct(
      ax0=-8.7,
      ay0=-190.9,
      az0=-190.4,
      ax1=-23.6,
      ay1=-45.5,
      az1=-12.9,
      ax2=-6.9,
      ay2=75.9,
      az2=6826.5,
      ax3=-33.2,
      ay3=14.36,
      az3=2,
      bx1=777.2,
      by1=58.9,
      bz1=276.6,
      VR=30,
      VT=44.5,
      VO=131.1,
      a=0.29,
      b=62.89,
      c=0.7,
      d=10.99,
      e=0.04)),
  RV_mm=struct(
    ax0=-8.7,
    ay0=-190.9,
    az0=-190.4,
    ax1=-23.6,
    ay1=-45.5,
    az1=-12.9,
    ax2=-6.9,
    ay2=75.9,
    az2=6826.5,
    ax3=-17.80971,
    ay3=13.97137,
    az3=1.783211,
    bx1=777.2,
    by1=58.9,
    bz1=276.6,
    VR=30,
    VT=44.5,
    VO=122.8702,
    a=0.29,
    b=62.89,
    c=0.7,
    d=10.99,
    e=0.04),
  RVm=struct(
    ax0=-8.7,
    ay0=-190.9,
    az0=-190.4,
    ax1=-23.6,
    ay1=-45.5,
    az1=-12.9,
    ax2=-6.9,
    ay2=75.9,
    az2=6826.5,
    ax3=-17.80971,
    ay3=13.97137,
    az3=1.783211,
    bx1=777.2,
    by1=58.9,
    bz1=276.6,
    VR=30,
    VT=44.5,
    VO=122.8702,
    a=0.29,
    b=62.89,
    c=0.7,
    d=10.99,
    e=0.04),
  LV_mm=struct(
    ax0=-8.7,
    ay0=-190.9,
    az0=-190.4,
    ax1=-23.6,
    ay1=-45.5,
    az1=-12.9,
    ax2=-6.9,
    ay2=75.9,
    az2=6826.5,
    ax3=-17.80971,
    ay3=13.97137,
    az3=1.783211,
    bx1=777.2,
    by1=58.9,
    bz1=276.6,
    VR=30,
    VT=44.5,
    VO=122.8702,
    a=0.29,
    b=62.89,
    c=0.7,
    d=10.99,
    e=0.04),
  LVm=struct(
    ax0=-8.7,
    ay0=-190.9,
    az0=-190.4,
    ax1=-23.6,
    ay1=-45.5,
    az1=-12.9,
    ax2=-6.9,
    ay2=75.9,
    az2=6826.5,
    ax3=-17.80971,
    ay3=13.97137,
    az3=1.783211,
    bx1=777.2,
    by1=58.9,
    bz1=276.6,
    VR=30,
    VT=44.5,
    VO=122.8702,
    a=0.29,
    b=62.89,
    c=0.7,
    d=10.99,
    e=0.04),
  path_1=struct(CVi2j=57, Dij=1, aij=0.01, bij=3.5, cij=0, CVj2i=57, Dji=1, aji=0.3, bji=62.89, cji=10.99),
  path_2=struct(CVi2j=40, Dij=1, aij=0.01, bij=3.5, cij=0, CVj2i=40, Dji=1, aji=0.3, bji=62.89, cji=10.99),
  path_3=struct(CVi2j=50, Dij=1, aij=0.01, bij=3.5, cij=0, CVj2i=50, Dji=1, aji=0.3, bji=62.89, cji=10.99),
  path_4=struct(CVi2j=80, Dij=1, aij=0.01, bij=3.5, cij=0, CVj2i=80, Dji=1, aji=0.3, bji=62.89, cji=10.99),
  path_5=struct(CVi2j=1000, Dij=1, aij=0.3, bij=62.89, cij=10.99, CVj2i=1000, Dji=1, aji=0.3, bji=62.89, cji=10.99),
  path_6=struct(CVi2j=1400, Dij=1, aij=0.3, bij=62.89, cij=10.99, CVj2i=1400, Dji=1, aji=0.3, bji=62.89, cji=10.99),
  path_7=struct(CVi2j=1000, Dij=1, aij=0.3, bij=62.89, cij=10.99, CVj2i=1000, Dji=1, aji=0.3, bji=62.89, cji=10.99),
  path_8=struct(CVi2j=700, Dij=1, aij=0.3, bij=62.89, cij=10.99, CVj2i=1000, Dji=1, aji=0.3, bji=62.89, cji=10.99),
  path_9=struct(CVi2j=1000, Dij=1, aij=0.3, bij=62.89, cij=10.99, CVj2i=1000, Dji=1, aji=0.3, bji=62.89, cji=10.99),
  path_10=struct(CVi2j=1300, Dij=1, aij=0.3, bij=62.89, cij=10.99, CVj2i=1300, Dji=0.1, aji=0.3, bji=62.89, cji=10.99),
  path_11=struct(CVi2j=1200, Dij=1, aij=0.3, bij=62.89, cij=10.99, CVj2i=1200, Dji=1, aji=0.3, bji=62.89, cji=10.99),
  path_12=struct(CVi2j=600, Dij=1, aij=0.3, bij=62.89, cij=10.99, CVj2i=600, Dji=1, aji=0.3, bji=62.89, cji=10.99),
  path_13=struct(CVi2j=1300, Dij=1, aij=0.3, bij=62.89, cij=10.99, CVj2i=1300, Dji=2, aji=0.01, bji=3.5, cji=0),
  path_14=struct(CVi2j=1300, Dij=1, aij=0.3, bij=62.89, cij=10.99, CVj2i=1300, Dji=1, aji=0.3, bji=62.89, cji=10.99),
  path_15=struct(CVi2j=70, Dij=2, aij=0.01, bij=3.5, cij=0, CVj2i=70, Dji=1, aji=0.3, bji=62.89, cji=10.99),
  path_16=struct(CVi2j=1000, Dij=1, aij=0.3, bij=62.89, cij=10.99, CVj2i=1000, Dji=1, aji=0.3, bji=62.89, cji=10.99),
  path_17=struct(CVi2j=1200, Dij=1, aij=0.3, bij=62.89, cij=10.99, CVj2i=1200, Dji=2, aji=0.07, bji=1.5, cji=0),
  path_18=struct(CVi2j=69, Dij=2, aij=0.01, bij=2, cij=0, CVj2i=70, Dji=1, aji=0.3, bji=62.89, cji=10.99),
  path_19=struct(CVi2j=700, Dij=1, aij=0.3, bij=62.89, cij=10.99, CVj2i=500, Dji=1, aji=0.3, bji=62.89, cji=10.99),
  path_20=struct(CVi2j=1300, Dij=1, aij=0.3, bij=62.89, cij=10.99, CVj2i=1300, Dji=1, aji=0.3, bji=62.89, cji=10.99),
  path_21=struct(CVi2j=800, Dij=1, aij=0.3, bij=62.89, cij=10.99, CVj2i=800, Dji=1, aji=0.3, bji=62.89, cji=10.99),
  path_22=struct(CVi2j=700, Dij=1, aij=0.3, bij=62.89, cij=10.99, CVj2i=700, Dji=1, aji=0.3, bji=62.89, cji=10.99),
  path_23=struct(CVi2j=3400, Dij=1, aij=0.3, bij=62.89, cij=10.99, CVj2i=3400, Dji=1, aji=0.3, bji=62.89, cji=10.99),
  path_24=struct(CVi2j=3400, Dij=1, aij=0.3, bij=62.89, cij=10.99, CVj2i=3400, Dji=1, aji=0.3, bji=62.89, cji=10.99),
  path_25=struct(CVi2j=3400, Dij=1, aij=0.3, bij=62.89, cij=10.99, CVj2i=3400, Dji=1, aji=0.3, bji=62.89, cji=10.99),
  path_26=struct(CVi2j=3200, Dij=1, aij=0.3, bij=62.89, cij=10.99, CVj2i=3200, Dji=1, aji=0.3, bji=62.89, cji=10.99),
  path_27=struct(CVi2j=3200, Dij=1, aij=0.3, bij=62.89, cij=10.99, CVj2i=3200, Dji=1, aji=0.3, bji=62.89, cji=10.99),
  path_28=struct(CVi2j=3200, Dij=1, aij=0.3, bij=62.89, cij=10.99, CVj2i=3200, Dji=1, aji=0.3, bji=62.89, cji=10.99),
  path_29=struct(CVi2j=3200, Dij=1, aij=0.3, bij=62.89, cij=10.99, CVj2i=3200, Dji=1, aji=0.3, bji=62.89, cji=10.99),
  path_30=struct(CVi2j=1000, Dij=1, aij=0.3, bij=62.89, cij=10.99, CVj2i=4000, Dji=1, aji=0.3, bji=62.89, cji=10.99),
  path_31=struct(CVi2j=2000, Dij=1, aij=0.3, bij=62.89, cij=10.99, CVj2i=2000, Dji=1, aji=0.3, bji=62.89, cji=10.99),
  path_32=struct(CVi2j=3200, Dij=1, aij=0.3, bij=62.89, cij=10.99, CVj2i=3200, Dji=1, aji=0.3, bji=62.89, cji=10.99),
  path_33=struct(CVi2j=1000, Dij=1, aij=0.3, bij=62.89, cij=10.99, CVj2i=4000, Dji=1, aji=0.3, bji=62.89, cji=10.99),
  path_34=struct(CVi2j=3200, Dij=1, aij=0.3, bij=62.89, cij=10.99, CVj2i=3200, Dji=1, aji=0.3, bji=62.89, cji=10.99),
  path_35=struct(CVi2j=1000, Dij=1, aij=0.3, bij=62.89, cij=10.99, CVj2i=4200, Dji=1, aji=0.3, bji=62.89, cji=10.99),
  path_36=struct(CVi2j=2000, Dij=1, aij=0.3, bij=62.89, cij=10.99, CVj2i=2000, Dji=1, aji=0.3, bji=62.89, cji=10.99),
  path_37=struct(CVi2j=434, Dij=1, aij=0.3, bij=62.89, cij=10.99, CVj2i=449, Dji=1, aji=0.3, bji=62.89, cji=10.99),
  path_38=struct(CVi2j=1000, Dij=1, aij=0.3, bij=62.89, cij=10.99, CVj2i=1000, Dji=1, aji=0.3, bji=62.89, cji=10.99),
  path_39=struct(CVi2j=1000, Dij=1, aij=0.3, bij=62.89, cij=10.99, CVj2i=1000, Dji=1, aji=0.3, bji=62.89, cji=10.99),
  path_40=struct(CVi2j=1000, Dij=1, aij=0.3, bij=62.89, cij=10.99, CVj2i=1000, Dji=1, aji=0.3, bji=62.89, cji=10.99),
  path_41=struct(CVi2j=1000, Dij=1, aij=0.3, bij=62.89, cij=10.99, CVj2i=1000, Dji=1, aji=0.3, bji=62.89, cji=10.99),
  path_42=struct(CVi2j=1000, Dij=1, aij=0.3, bij=62.89, cij=10.99, CVj2i=1000, Dji=1, aji=0.3, bji=62.89, cji=10.99),
  path_43=struct(CVi2j=434, Dij=1, aij=0.3, bij=62.89, cij=10.99, CVj2i=449, Dji=1, aji=0.3, bji=62.89, cji=10.99),
  path_44=struct(CVi2j=434, Dij=1, aij=0.3, bij=62.89, cij=10.99, CVj2i=449, Dji=1, aji=0.3, bji=62.89, cji=10.99),
  path_45=struct(CVi2j=2000, Dij=1, aij=0.3, bij=62.89, cij=10.99, CVj2i=2000, Dji=1, aji=0.3, bji=62.89, cji=10.99),
  path_46=struct(CVi2j=1000, Dij=1, aij=0.3, bij=62.89, cij=10.99, CVj2i=2000, Dji=1, aji=0.3, bji=62.89, cji=10.99),
  path_47=struct(CVi2j=1000, Dij=1, aij=0.3, bij=62.89, cij=10.99, CVj2i=2000, Dji=1, aji=0.3, bji=62.89, cji=10.99),
  path_48=struct(CVi2j=1000, Dij=1, aij=0.3, bij=62.89, cij=10.99, CVj2i=1000, Dji=1, aji=0.3, bji=62.89, cji=10.99),
  path_49=struct(CVi2j=1000, Dij=1, aij=0.3, bij=62.89, cij=10.99, CVj2i=1000, Dji=1, aji=0.3, bji=62.89, cji=10.99),
  path_50=struct(CVi2j=2000, Dij=1, aij=0.3, bij=62.89, cij=10.99, CVj2i=2000, Dji=1, aji=0.3, bji=62.89, cji=10.99),
  path_51=struct(CVi2j=1000, Dij=1, aij=0.3, bij=62.89, cij=10.99, CVj2i=2000, Dji=1, aji=0.3, bji=62.89, cji=10.99),
  path_52=struct(CVi2j=1000, Dij=1, aij=0.3, bij=62.89, cij=10.99, CVj2i=2000, Dji=1, aji=0.3, bji=62.89, cji=10.99),
  path_53=struct(CVi2j=1000, Dij=1, aij=0.3, bij=62.89, cij=10.99, CVj2i=1000, Dji=1, aji=0.3, bji=62.89, cji=10.99),
  path_54=struct(CVi2j=1000, Dij=1, aij=0.3, bij=62.89, cij=10.99, CVj2i=1000, Dji=1, aji=0.3, bji=62.89, cji=10.99))