% Simulink data dictionary Path_dd.sldd
% references cell_out_type.sldd
% references P_cfg_type.sldd
% references Path2Probe_type.sldd

celli = Simulink.Signal(DataType="Bus: Cell")
cellj = Simulink.Signal(DataType="Bus: Cell")
p_act = Simulink.Signal(DataType="Bus: Activation")
cfg_default_path = Simulink.Parameter(struct(CVi2j=57, Dij=1, aij=0.01, bij=3.5, cij=0, CVj2i=57, Dji=1, aji=0.3, bji=62.89, cji=10.99), DataType="Bus: Config_Path")
cfg_path = Simulink.Signal(InitialValue="cfg_default_path", StorageClass="ExportedGlobal", DataType="Bus: Config_Path")